% Simulink data dictionary plant_buses.sldd

vehicle_state_bus = Simulink.Bus()
  v_ned_mps: double[3 1], Unit="m/s"  % NED velocity
  pos_ned_m: double[3 1], Unit="m"  % NED position
  euler_ang_rad: double[3 1], Unit="rad"  % Roll, Pitch, Yaw
  dcm_ned_2_body: double[3 3], Unit="1"  % NED to Body axis DCM
  v_body_mps: double[3 1], Unit="m/s"  % Velocity represented in body axis
  body_rates_radps: double[3 1], Unit="rad/s"  % Body rates, p, q, r
  body_ang_acc_radps2: double[3 1], Unit="rad/s^2"  % Body angular accelerations
  accel_body_mps2: double[3 1], Unit="m/s^2"  % Acceleration in body axis